test file "reactionJetControl_test"
  setup callback:
    origdir = pwd;
    addpath(origdir);
    tmpdir = tempname;
    mkdir(tmpdir);
    cd(tmpdir);
    copyfile(fullfile(origdir, 'work', 'cache', '*.slxc'), pwd);
    cfg = Simulink.fileGenControl('getConfig');
    Simulink.fileGenControl('set', 'CacheFolder', pwd, 'CodeGenFolder', pwd);
  cleanup callback:
    close_system('ReactionJetControl', 0);
    cd(origdir);
    clear mex;
    rmdir(tmpdir, 's');
    Simulink.fileGenControl('setConfig', 'config', cfg);

suite "Test suite 1"

  case "Equivalence Test" [equivalence]
    simulation 1:
      model ReactionJetControl, mode Software-in-the-Loop (SIL)
      input "testInput.mat", mapped to Attitude
Cmd., Attitude
Meas., NofJets, PitchRollJets (active)
    simulation 2:
      model ReactionJetControl
      input "testInput.mat", mapped to Attitude
Cmd., Attitude
Meas., NofJets, PitchRollJets (active)
    equivalence criteria
      Pitch and Roll Jets(1)
      Yaw Jets
      Yaw Control Law:2(1)
      Pitch and Roll Jets(2)
      Yaw Control Law:2(2)
      Yaw Jets
      Pitch and Roll Jets(1)
      Pitch and Roll Jets(2)
      e_edot(1)
      e_edot(2)